# Grasshopper definition BasicAddition.ghx (Grasshopper 1.0.7)
# plug-ins: sof_gh_sofistik-2022
# This revision contains a basic addition of three numbers

io = IO(
    SofistikDocumentProperties_VersionMajor="2022",
    SofistikDocumentProperties_VersionMinor="2",
    SofistikDocumentProperties_VersionName="2022")
B = GetInteger(AtLeast=1, AtMost=1, Maximum=2147483647, Minimum=-2147483648, Prompt="B")
A = GetInteger(AtLeast=1, AtMost=1, Maximum=2147483647, Minimum=-2147483648, Prompt="A")
C = GetInteger(AtLeast=1, AtMost=1, Maximum=2147483647, Minimum=-2147483648, Prompt="C")
addition = Addition(A=A, B=B, C=C)

# ---- group: RH_OUT:Num
num = Number(addition)

# ---- group: RH_OUT:Int
int = Integer(addition)
